# Dynamo graph ListAssetLocation.dyn (Dynamo 2.6.1.8786)

file_path = Filename(".\asset_location_data_export.csv")
code_block = CodeBlock { ["Level", "Room"]; }
list_create = List.Create(item0=code_block)
categories = Categories("OST_Rooms")
all_elements_of_category = ElementsOfCategory(Category=categories)
code_block_2 = CodeBlock { "Level"; }
getParameterValueByName = Element.GetParameterValueByName(parameterName=code_block_2)  # unwired: element
sortByFunction = List.SortByFunction(list=all_elements_of_category, func=getParameterValueByName)
code_block_3 = CodeBlock { "Level"; }
getParameterValueByName_2 = Element.GetParameterValueByName(element=sortByFunction, parameterName=code_block_3)
name = Element.Name(element=sortByFunction)
list_create_2 = List.Create(item0=getParameterValueByName_2, item1=name)
transpose = List.Transpose(lists=list_create_2)
join = List.Join(list0=list_create, list1=transpose)
exportCSV = Data.ExportCSV(filePath=file_path, data=join)
