# Dynamo graph ListElementsByRooms.dyn (Dynamo 2.6.1.8786)
# packages: archi-lab.net 2021.25.17

code_block = CodeBlock { "Asset Category"; "Asset Location"; "Asset ID"; "Assets"; }
parameter_types = ParameterTypeUi("Text")
parameter_groups = ParameterGroupUi("PG_IDENTITY_DATA")
boolean = BoolSelector(true)
createSharedParameterForAllCategories = Parameter.CreateSharedParameterForAllCategories(parameterName=code_block.out0, groupName=code_block.out3, type=parameter_types, group=parameter_groups, instance=boolean)
createSharedParameterForAllCategories_2 = Parameter.CreateSharedParameterForAllCategories(parameterName=code_block.out1, groupName=code_block.out3, type=parameter_types, group=parameter_groups, instance=boolean)
createSharedParameterForAllCategories_3 = Parameter.CreateSharedParameterForAllCategories(parameterName=code_block.out2, groupName=code_block.out3, type=parameter_types, group=parameter_groups, instance=boolean)
file_path = Filename(".\asset_data_export.csv")
code_block_2 = CodeBlock { ["Asset ID", "Category", "Location", "External Id"]; }
list_create = List.Create(item0=code_block_2)
categories = Categories("OST_MechanicalEquipment")
all_elements_of_category = ElementsOfCategory(Category=categories)
categories_2 = Categories("OST_DuctTerminal")
all_elements_of_category_2 = ElementsOfCategory(Category=categories_2)
categories_3 = Categories("OST_ElectricalFixtures")
all_elements_of_category_3 = ElementsOfCategory(Category=categories_3)
categories_4 = Categories("OST_ElectricalEquipment")
all_elements_of_category_4 = ElementsOfCategory(Category=categories_4)
categories_5 = Categories("OST_LightingDevices")
all_elements_of_category_5 = ElementsOfCategory(Category=categories_5)
categories_6 = Categories("OST_LightingFixtures")
all_elements_of_category_6 = ElementsOfCategory(Category=categories_6)
join = List.Join(list0=all_elements_of_category, list1=all_elements_of_category_2, list2=all_elements_of_category_3, list3=all_elements_of_category_4, list4=all_elements_of_category_5, list5=all_elements_of_category_6)
categories_7 = Categories("OST_Rooms")
all_elements_of_category_7 = ElementsOfCategory(Category=categories_7)
elements_in_room = Custom[Elements in Room](elements=join, rooms=all_elements_of_category_7)  # package archi-lab.net; This node will check if any of the elements are inside any of the supplied rooms.
flatten = List.Flatten(list=elements_in_room)
id = Element.Id(element=flatten)
string_from_object = FromObject(obj=id)
setParameterByName = Element.SetParameterByName(element=flatten, parameterName=code_block.out2, value=string_from_object)
getParameterValueByName = Element.GetParameterValueByName(element=setParameterByName, parameterName=code_block.out2)
flatten_2 = List.Flatten(list=getParameterValueByName)
getCategory = Element.GetCategory(element=flatten)
name = Category.Name(category=getCategory)
type = archilab.Revit.Elements.Elements.Type(element=flatten)
family = FamilyType.Family(familyType=type)
name_2 = Element.Name(element=family)
name_3 = Element.Name(element=type)
code_block_3 = CodeBlock(cate=name, family=name_2, type=name_3) { cate + " > " + family + " > " + type; }
setParameterByName_2 = Element.SetParameterByName(element=flatten, parameterName=code_block.out0, value=code_block_3)
getParameterValueByName_2 = Element.GetParameterValueByName(element=setParameterByName_2, parameterName=code_block.out0)
flatten_3 = List.Flatten(list=getParameterValueByName_2)
code_block_4 = CodeBlock { "Level"; }
getParameterValueByName_3 = Element.GetParameterValueByName(element=all_elements_of_category_7, parameterName=code_block_4)
name_4 = Element.Name(element=all_elements_of_category_7)
code_block_5 = CodeBlock(lvl=getParameterValueByName_3, room=name_4) { lvl + " > " + room; }
setParameterByName_3 = Element.SetParameterByName(element=elements_in_room, parameterName=code_block.out1, value=code_block_5)
getParameterValueByName_4 = Element.GetParameterValueByName(element=setParameterByName_3, parameterName=code_block.out1)
flatten_4 = List.Flatten(list=getParameterValueByName_4)
uniqueId = Element.UniqueId(element=setParameterByName_3)
flatten_5 = List.Flatten(list=uniqueId)
list_create_2 = List.Create(item0=flatten_2, item1=flatten_3, item2=flatten_4, item3=flatten_5)
transpose = List.Transpose(lists=list_create_2)
join_2 = List.Join(list0=list_create, list1=transpose)
exportCSV = Data.ExportCSV(filePath=file_path, data=join_2)
